# Grasshopper definition bubble_shapes.gh (Grasshopper 1.0.7)
# plug-ins: Vespidae

range = Range(Domain=Domain(0, 1), Steps=Slider(150, range=0..1000))
graph = GraphMapper(range, x0=0, x1=1, y0=0, y1=1, container_name="Bezier", cpx=[0, 0.2173912972, 0.8043478131, 1], cpy=[0, 1, 1, 0])
graph_2 = GraphMapper(range, x0=0, x1=1, y0=0, y1=1, container_name="Sine", Equation_px=[0, 0.05072463676], Equation_py=[0, 0.9831932783])
dom = ConstructDomain(DomainStart=Slider(0, range=0..100), DomainEnd=Slider(0.7, range=0..1))
dom_2 = ConstructDomain(DomainStart=Slider(50, range=0..100), DomainEnd=Slider(58, range=0..100))
remap = RemapNumbers(Value=graph_2, Source=Domain(0, 1), Target=dom)  # -> Mapped, Clipped
remap_2 = RemapNumbers(Value=graph, Source=Domain(0, 1), Target=dom_2)  # -> Mapped, Clipped
pt = Point(Point(20, 0, 0))
addition = Addition(A=remap_2.Mapped, B=remap.Mapped)
c_script = CSharpScript(rad=pt, y=Slider(0.3, range=0..1), w=addition)  # -> out, A; inputs rad: Point3d, y: Double, w: list of Double
# ---------- c_script: C# ----------
var poly = new Polyline();

var res = 5; //resolution
var layerHeight = 0.2;

double z = 0.27;
var lengt = w.Count;
bool first = true;
foreach(var width in w){
    for(int i = 0; i < 360; i=i+res){
        var p = new Point3d(Math.Cos(RhinoMath.ToRadians(i))*width, Math.Sin(RhinoMath.ToRadians(i))*width, z);
        poly.Add(p);
        if(first){
            z = 0.27;
        }
        else{
            z += layerHeight/(360/res);
        }
    }
    first = false;
}

A = poly;
# ---------- end c_script ----------
number_slider = Slider(71, range=0..100)
X = UnitX(Factor=number_slider)
pipeline = GeometryPipeline(
    GroupByLayer=False,
    GroupByType=False,
    IncludeHidden=True,
    IncludeLocked=True,
    LayerFilter="Layer 05",
    NameFilter="*",
    SublayerFiltering=True,
    TypeFilter=4)
pipeline_2 = GeometryPipeline(
    GroupByLayer=False,
    GroupByType=False,
    IncludeHidden=True,
    IncludeLocked=True,
    LayerFilter="test_lines",
    NameFilter="*",
    SublayerFiltering=True,
    TypeFilter=4)
move = Move(Geometry=c_script.A, Motion=X)  # -> Geometry, Transform
Y = UnitY(Factor=number_slider)
move_2 = Move(Geometry=move.Geometry, Motion=Y)  # -> Geometry, Transform
vespextrusion = ExtrusionComponent(
    Curve=move_2.Geometry,
    Extrusion=Slider(1, range=0..10),
    Speed=Slider(1500, range=0..10000),
    Temperature=205,
    Retract=2,
    ToolId=0,
    ExtType=0)
vespextrusion_2 = ExtrusionComponent(Curve=pipeline_2, Extrusion=Slider(0.8, range=0..1), Speed=1000, Temperature=205, Retract=2, ToolId=0, ExtType=0)
merge = Merge(Data1=vespextrusion_2, Data2=vespextrusion)  # -> flatten(Result)
solve = SolveActionsComponent(Actions=merge, RetractHeight=Slider(32, range=0..100), TravelSpeed=5000, PartialRetract=False)
panel = Panel(""";START_OF_HEADER
;HEADER_VERSION:0.1
;FLAVOR:Griffin
;GENERATOR.NAME:Cura_SteamEngine
;GENERATOR.VERSION:5.0.0
;GENERATOR.BUILD_DATE:2022-05-17
;TARGET_MACHINE.NAME:Ultimaker 3 Extended
;EXTRUDER_TRAIN.0.INITIAL_TEMPERATURE:210
;EXTRUDER_TRAIN.0.MATERIAL.VOLUME_USED:89699
;EXTRUDER_TRAIN.0.MATERIAL.GUID:506c9f0d-e3aa-4bd4-b2d2-23e2425b1aa9
;EXTRUDER_TRAIN.0.NOZZLE.DIAMETER:0.4
;EXTRUDER_TRAIN.0.NOZZLE.NAME:AA 0.4
;BUILD_PLATE.TYPE:glass
;BUILD_PLATE.INITIAL_TEMPERATURE:60
;PRINT.TIME:40836
;PRINT.GROUPS:1
;PRINT.SIZE.MIN.X:9
;PRINT.SIZE.MIN.Y:6
;PRINT.SIZE.MIN.Z:0.27
;PRINT.SIZE.MAX.X:144.417
;PRINT.SIZE.MAX.Y:135.485
;PRINT.SIZE.MAX.Z:44.07
;END_OF_HEADER
;Generated with Cura_SteamEngine 5.0.0
T0""")
panel_2 = Panel("""G91 ;Relative movement
G0 F15000 X8.0 Z0.5 E-4.5 ;Wiping+material retraction
G0 F10000 Z1.5 E4.5 ;Compensation for the retraction
G90 ;Disable relative movement""")
viz_paths = VisualizePaths(Actions=solve, ArrowScl=1, ArrowDensity=1)  # -> AllMoves, Moves, Extrude, Travel, Arrows
vespmogcode = Vespmo_Gcode_Component(Actions=solve, Header=panel, Footer=panel_2, Absolute=Toggle(True))
item = ListItem(List=viz_paths.AllMoves, Index=Slider(8, range=0..100), Wrap=True)
panel_3 = Panel(vespmogcode)
