# Grasshopper definition drawer_gen.gh (Grasshopper 1.0.7)

width = Slider(800, range=0..1000)
length = Slider(600, range=0..800)
height = Slider(200, range=0..350)
material = Slider(15, range=0..100)

# ----
# bottom
multiplication = Multiplication(A=material, B=2)
pt = ConstructPoint(XCoordinate=width, YCoordinate=length, ZCoordinate=multiplication)
pt_2 = ConstructPoint(XCoordinate=0, YCoordinate=0, ZCoordinate=material)
box = Box2Pt(PointA=pt_2, PointB=pt, Plane=PlaneXY(0, 0, 0))

# ----
# back
multiplication_2 = Multiplication(A=material, B=2)
multiplication_3 = Multiplication(A=material, B=2)
subtraction = Subtraction(A=width, B=multiplication_2)
subtraction_2 = Subtraction(A=length, B=material)
subtraction_3 = Subtraction(A=length, B=multiplication_3)
pt_3 = ConstructPoint(XCoordinate=expr("x*2", material), YCoordinate=subtraction_2, ZCoordinate=expr("x*2", material))
pt_4 = ConstructPoint(XCoordinate=subtraction, YCoordinate=subtraction_3, ZCoordinate=height)
box_2 = Box2Pt(PointA=pt_3, PointB=pt_4, Plane=PlaneXY(0, 0, 0))

# ----
# sides
division = Division(A=width, B=2)
pt_5 = ConstructPoint(XCoordinate=material, YCoordinate=0, ZCoordinate=expr("x*2", material))
pt_6 = ConstructPoint(XCoordinate=expr("x*2", material), YCoordinate=length, ZCoordinate=height)
pt_7 = ConstructPoint(XCoordinate=division, YCoordinate=0, ZCoordinate=0)
Z = UnitZ(Factor=1)
pl = ConstructPlane(Origin=pt_7, XAxis=Z, YAxis=Vector(0, 1, 0))
box_3 = Box2Pt(PointA=pt_5, PointB=pt_6, Plane=PlaneXY(0, 0, 0))
mirror = Mirror(Geometry=box_3, Plane=pl)  # -> Geometry, Transform

# ----
# front
addition = Addition(A=height, B=Slider(25, range=0..100))
neg = Negative(Value=material)
addition_2 = Addition(A=width, B=material)
pt_8 = ConstructPoint(XCoordinate=neg, YCoordinate=0, ZCoordinate=0)
pt_9 = ConstructPoint(XCoordinate=addition_2, YCoordinate=neg, ZCoordinate=addition)
box_4 = Box2Pt(PointA=pt_8, PointB=pt_9, Plane=PlaneXY(0, 0, 0))

pt_10 = ConstructPoint(XCoordinate=expr("x/2 + x/4 + 50", width), YCoordinate=expr("x/2*-1", material), ZCoordinate=expr("x*2", material))
pt_11 = ConstructPoint(XCoordinate=expr("x/2 + x/4", width), YCoordinate=0, ZCoordinate=material)
box_5 = Box2Pt(PointA=pt_11, PointB=pt_10, Plane=PlaneXY(0, 0, 0))
mirror_2 = Mirror(Geometry=box_5, Plane=pl)  # -> Geometry, Transform
debox = DeconstructBox(Box=box)  # -> Plane, X, Y, Z
merge = Merge(Data1=box, Data2=box_3, Data3=mirror.Geometry, Data4=box_4, Data5=box_2)
group = Group(Objects=merge)
wires = BrepWireframe(Brep=merge, Density=-1)
