# Grasshopper definition flatten_kangeroo.gh (Grasshopper 1.0.7)
# plug-ins: LunchBox, Kangaroo2 Components

srf = Surface(<surface referenced from the Rhino model>)
edges = BrepEdges(Brep=srf)  # -> Naked, Interior, NonManifold
rebuildsrf = RebuildSurface(
    Surface=srf,
    UDegree=Slider(3, range=0..10),
    VDegree=Slider(4, range=0..10),
    UNumber=Slider(39, range=0..100),
    VNumber=Slider(66, range=0..100))
graft = GraftTree(Tree=edges.Naked, IncludeEmptyLists=True, IncludeNullItems=True)
diamond = DiamondPanels(Surface=srf, UDivisions=10, VDivisions=10)  # -> DiamondPanels, TriPanels
hex = HexagonCells(
    Surface=rebuildsrf,
    UDivisions=Slider(21, range=0..100),
    VDivisions=Slider(15, range=0..100),
    TParameter=Slider(0.3, range=0.1..1))  # -> HexagonCells, Centers
cp = ControlPoints(Curve=hex.HexagonCells)  # -> Points, Weights, Knots
explode = Explode(Curve=hex.HexagonCells, Recursive=True)  # -> flatten(Segments), Vertices
flatten = FlattenTree(Tree=cp.Points, Path="{0}")
planerize = Slider(18.836, range=0..1000)
planerize_2 = Slider(1000, range=0..1000)
dupln = RemoveDuplicateLines(Lines=explode.Segments, Tolerance=0.01)
duppt = RemoveDuplicatePts(Points=flatten, Tolerance=0.01)
number_slider = Slider(0.01, range=0..1)
crv_cp = CurveClosestPoint(Point=duppt, Curve=graft)  # -> Point, Parameter, Distance
len = Length(Curve=dupln)
show = Show(G=hex.HexagonCells)
smaller = SmallerThan(FirstNumber=crv_cp.Distance, SecondNumber=Slider(6, range=0..100))  # -> SmallerThan, OrEqualTo
cull = CullPattern(List=crv_cp.Point, CullPattern=smaller.SmallerThan)
coplanar = CoPlanar(Points=cp.Points, Strength=planerize_2)
ct = ConstantTension(Line=dupln, Strength=number_slider)
length_line = LengthLine(Line=dupln, Length=len, Strength=number_slider)
oncurve = OnCurve(Points=cull, Curve=graft, Strength=planerize)
panel = Panel(smaller.SmallerThan)
merge = Merge(Data1=show, Data2=length_line, Data3=coplanar, Data4=oncurve, Data5=ct)
flatten_2 = FlattenTree(Tree=merge, Path="{0}")
solver = Solver(GoalObjects=flatten_2, Reset=Button(), Threshold=1e-15, Tolerance=0.01, On=Toggle(False))  # -> I, V, graft(O)
item = ListItem(List=solver.O, Index=Slider(43, range=0..100), Wrap=True)
boundary = BoundarySurfaces(Edges=solver.O)
pline = PolyLine(Vertices=solver.O, Closed=False)
viewer = ParamViewer(solver.O)
crv = Curve(solver.O)
srf_2 = Surface(crv)
deplane = DeconstructPlane(Plane=boundary)  # -> Origin, XAxis, YAxis, ZAxis
vdis = VectorDisplay(Anchor=deplane.Origin, Vector=deplane.ZAxis)
multiplication = Multiplication(A=deplane.ZAxis, B=Slider(0.13, range=0..1))
multiplication_2 = Multiplication(A=deplane.ZAxis, B=Slider(1, range=0..50))
extrude = ExtrudeLinear(OrientationP=PlaneXY(0, 0, 0))
move = Move(Geometry=boundary, Motion=multiplication_2)  # -> Geometry, Transform
vec2pt = Vector2Pt(PointA=move.Geometry, Unitize=False)  # -> Vector, Length
extr = Extrude(Base=srf_2, Direction=multiplication)
merge_2 = Merge(Data1=boundary, Data2=move.Geometry)
loft = Loft(Curves=merge_2, Options={Adjust=False, Closed=False, LoftEnds=0, LoftSimp=0, LoftType=0, Rebuild=10, Refit=0.01})
item_2 = ListItem(List=loft, Index=0, Wrap=True)
