# Grasshopper definition new_experiment.gh (Grasshopper 1.0.7)
# plug-ins: LunchBox

srf = Surface(<surface referenced from the Rhino model>)
hex = HexagonCells(Surface=srf, UDivisions=Slider(22, range=0..100), VDivisions=Slider(27, range=0..100), TParameter=0.25)  # -> HexagonCells, Centers
quads = QuadPanels(Surface=srf, UDivisions=10, VDivisions=10)
rebuildsrf = RebuildSurface(Surface=srf, UDegree=Slider(3, range=0..10), VDegree=3, UNumber=Slider(0, range=0..100), VNumber=Slider(0, range=0..100))
diamond = DiamondPanels(Surface=srf, UDivisions=Slider(24, range=0..100), VDivisions=Slider(25, range=0..100))  # -> DiamondPanels, TriPanels
squads = SkewedQuads(Surface=srf, UDivisions=10, VDivisions=10, TParameter=0)  # -> FullPanels, EdgePanels
trib = TrianglePanelsB(Surface=srf, UDivisions=10, VDivisions=10)
hex_2 = HexagonCells(Surface=rebuildsrf, UDivisions=Slider(13, range=0..100), VDivisions=Slider(11, range=0..100), TParameter=0.25)  # -> HexagonCells, Centers
srf_2 = Surface(hex.HexagonCells)
evalsrf = EvaluateSurface(Surface=diamond.TriPanels)  # -> Point, Normal, UDirection, VDirection, Frame
flat = FlatnessCheck(PanelList=diamond.DiamondPanels)  # -> FlatPanels, Planes, Deviations
panel = Panel(hex.HexagonCells)
frame = PanelFrame(ScaleFactor=0.5)  # -> PanelFrame, Panel
deplane = DeconstructPlane(Plane=flat.FlatPanels)  # -> Origin, XAxis, YAxis, ZAxis
flat_2 = FlatnessCheck()  # -> FlatPanels, Planes, Deviations
flat_3 = FlatnessCheck()  # -> FlatPanels, Planes, Deviations
vdis = VectorDisplay(Anchor=deplane.Origin, Vector=deplane.ZAxis)
