# Grasshopper definition calibrate_ultimaker.gh (Grasshopper 1.0.7)

number_slider = Slider(0, range=0..100)
number_slider_2 = Slider(150, range=0..200)
number_slider_3 = Slider(177, range=0..200)
number_slider_4 = Slider(24, range=0..100)
pt = ConstructPoint(XCoordinate=0, YCoordinate=0, ZCoordinate=0)
pt_2 = ConstructPoint(XCoordinate=Slider(200, range=0..200), YCoordinate=Slider(200, range=0..200), ZCoordinate=Slider(147, range=0..200))
pt_3 = ConstructPoint(XCoordinate=0, YCoordinate=number_slider_3, ZCoordinate=number_slider)
pt_4 = ConstructPoint(XCoordinate=number_slider_2, YCoordinate=number_slider_3, ZCoordinate=number_slider)
pt_5 = ConstructPoint(XCoordinate=0, YCoordinate=0, ZCoordinate=number_slider)
pt_6 = ConstructPoint(XCoordinate=number_slider_2, YCoordinate=0, ZCoordinate=number_slider)
box = Box2Pt(PointA=pt, PointB=pt_2, Plane=PlaneXY(0, 0, 0))
wires = BrepWireframe(Brep=box, Density=-1)
ln = Line(StartPoint=pt_3, EndPoint=pt_4)
ln_2 = Line(StartPoint=pt_5, EndPoint=pt_6)
panel = Panel("""False
True
True
False""")
divide = DivideCurve(Curve=ln, Count=number_slider_4, Kinks=False)  # -> Points, Tangents, Parameters
divide_2 = DivideCurve(Curve=ln_2, Count=number_slider_4, Kinks=False)  # -> Points, Tangents, Parameters
weave = Weave(Pattern=panel, Stream0=divide_2.Points, Stream1=divide.Points, NullGaps=False)
shift = ShiftList(List=weave, Shift=Slider(1, range=0..1), Wrap=True)
feed = Slider(10000, range=0..10000)
dist = Distance(PointA=divide.Points, PointB=divide_2.Points)
lng = ListLength(List=shift)
ln_3 = Line(StartPoint=weave, EndPoint=shift)
subtraction = Subtraction(A=lng, B=1)
c_script = CSharpScript(x=weave, y=feed, TooltipDescriptionOverride="This is frikk", TooltipTextOverride="makes gcode ")  # -> out, A; inputs x: Point3d
# ---------- c_script: C# ----------
String s = String.Format("G0 X{0} Y{1} Z{2} F{3}", x[0], x[1], x[2],y);
A = s;
# ---------- c_script: C# additional code ----------
  //Return a BoundingBox that contains all the geometry you are about to draw.
  public override BoundingBox ClippingBox
  {
    get
    {
      return BoundingBox.Empty;
    }
  }

  //Draw all meshes in this method.
  public override void DrawViewportMeshes(IGH_PreviewArgs args)
  {
  }

  //Draw all wires and points in this method.
  public override void DrawViewportWires(IGH_PreviewArgs args)
  {
  }
# ---------- end c_script ----------
cull_i = CullIndex(List=ln_3, Indices=subtraction, Wrap=True)
panel_2 = Panel(""";START_OF_HEADER
;HEADER_VERSION:0.1
;FLAVOR:Griffin
;GENERATOR.NAME:Cura_SteamEngine
;GENERATOR.VERSION:4.8.0
;GENERATOR.BUILD_DATE:2020-11-10
;TARGET_MACHINE.NAME:Ultimaker 3 Extended
;EXTRUDER_TRAIN.1.INITIAL_TEMPERATURE:35
;EXTRUDER_TRAIN.1.MATERIAL.VOLUME_USED:4450
;EXTRUDER_TRAIN.1.MATERIAL.GUID:506c9f0d-e3aa-4bd4-b2d2-23e2425b1aa9
;EXTRUDER_TRAIN.1.NOZZLE.DIAMETER:0.4
;EXTRUDER_TRAIN.1.NOZZLE.NAME:AA 0.4
;BUILD_PLATE.TYPE:glass
;BUILD_PLATE.INITIAL_TEMPERATURE:25
;PRINT.TIME:0
;PRINT.GROUPS:1
;PRINT.SIZE.MIN.X:68.525
;PRINT.SIZE.MIN.Y:6
;PRINT.SIZE.MIN.Z:0.2
;PRINT.SIZE.MAX.X:204
;PRINT.SIZE.MAX.Y:125.597
;PRINT.SIZE.MAX.Z:18
;END_OF_HEADER
;Generated with Cura_SteamEngine 4.8.0
T1""")
join = JoinCurves(Curves=cull_i, Preserve=False)
merge = Merge(Data1=panel_2, Data2=c_script.A)  # -> flatten(Result)
c_script_2 = CSharpScript(x=merge)  # -> out, A; inputs x: list of String
# ---------- c_script_2: C# usings ----------
using System.IO;
# ---------- c_script_2: C# ----------
System.IO.StreamWriter sw = File.CreateText("/Users/frikkfossdal/Documents/calib.gcode");

foreach(string line in x){
    sw.WriteLine(line); 
    }
sw.Close();
# ---------- end c_script_2 ----------
panel_3 = Panel(merge)
