# Grasshopper definition trouchet_to_gcode.gh (Grasshopper 1.0.7)

number_slider = Slider(100, range=0..100)
trouchet_program = TrouchetProgram(relay=Slider(12, range=0..20), relay_2=Slider(6, range=0..100))  # -> curves, A
crv = Curve(trouchet_program.curves)
topoly = CurveToPolyline(
    Curve=trouchet_program.curves,
    ToleranceDistance=Slider(0.1, range=0..10),
    ToleranceAngle=degrees(Slider(12, range=0..45)))  # -> flatten(Polyline), Segments
viewer = ParamViewer(topoly.Polyline)
c_script = CSharpScript(x=topoly.Polyline)  # -> out, A; inputs x: tree
# ---------- c_script: C# ----------
var gcode = new List<string>();



A = x;
# ---------- end c_script ----------
cp = ControlPoints(Curve=topoly.Polyline)  # -> Points, Weights, Knots
rev = ReverseList(List=cp.Points)
item = ListItem(List=cp.Points, Index=0, Wrap=True)
c_script_2 = CSharpScript(x=topoly.Polyline)  # -> out, A, B; inputs x: list of Polyline
# ---------- c_script_2: C# ----------
var pts = x;
var gcode = new List<string>();

foreach(Polyline p in pts){
    gcode.Add("done"); 
    foreach(Point3d f in p){
        gcode.Add(string.Format("G0 X{0}",f.X)); 
        }
}


A = pts[3][0].X;
B = gcode;
# ---------- end c_script_2 ----------
number_slider_2 = Slider(1, range=0..10)
item_2 = ListItem(List=rev, Index=0, Wrap=True)
points = PointList(Points=cp.Points, Size=Slider(0.5, range=0..1))
panel = Panel(cp.Points)

# ==== cluster TrouchetProgram
relay = ClusterInput()
relay_2 = ClusterInput()
sqgrid = Square(Plane=PlaneXY(0, 0, 0), Size=relay, ExtentX=relay_2, ExtentY=relay_2)  # -> graft(Cells), Points
explode = Explode(Curve=sqgrid.Cells, Recursive=True)  # -> Segments, Vertices
number_slider = Slider(3, range=0..10)
midpt = CurveMiddle(Curve=explode.Segments)
pcen = PolygonCenter(Polyline=sqgrid.Cells)  # -> CenterV, CenterE, CenterA
item = ListItem(List=midpt, Index=0, Wrap=True)  # -> Item, Item1, Item2, Item3
Y = UnitY(Factor=number_slider)
X = UnitX(Factor=number_slider)
bzspan = BezierSpan(StartPoint=item.Item, StartTangent=Y, EndPoint=item.Item3, EndTangent=X)  # -> Curve, Length, Domain
rot3d = Rotate3D(Geometry=bzspan.Curve, Angle=degrees(Slider(180, range=0..1000)), Center=pcen.CenterV, Axis=Vector(0, 0, 1))  # -> Geometry, Transform
merge = Merge(Data1=rot3d.Geometry, Data2=bzspan.Curve)
tstat = TreeStatistics(Tree=merge)  # -> Paths, Length, Count
random = Random(Range="0 to 3", Number=tstat.Count, Seed=2, Integers=True)
multiplication = Multiplication(A=random, B="90")  # -> graft(Result)
pline = PolyLine(Closed=False)
redpline = Reduce(Tolerance=1)  # -> Polyline, Reduction
rot3d_2 = Rotate3D(Geometry=merge, Angle=degrees(multiplication), Center=pcen.CenterV, Axis=Vector(0, 0, 1))  # -> flatten(Geometry), Transform
join = JoinCurves(Curves=rot3d_2.Geometry, Preserve=False)  # -> graft(Curves)
curves = ClusterOutput(join)
preview = CustomPreview(
    Geometry=join,
    Material={diffuse=RGB(221, 160, 221), emission=RGB(66, 48, 66), shine=0.5, specular=RGB(255, 255, 255), transparency=0})
points = PointList(Size=Slider(1, range=0..10))
c_script = CSharpScript(feed=Slider(6016, range=0..10000))  # -> out, flatten(A); inputs points: list of Point3d
# ---------- c_script: C# ----------
List <string> code = new List<string>();


foreach(Point3d p in points){
    code.Add(string.Format("G0 X{0} Y{1}", p.X, p.Y));
}

code.Add("END");




A = code;
# ---------- end c_script ----------
A = ClusterOutput(c_script.A)
