# Grasshopper definition parawall.gh (Grasshopper 1.0.7)

number_slider = Slider(16, range=0..40)  # disabled
curve = Curve(<curve referenced from the Rhino model>)  # disabled
number_slider_2 = Slider(26, range=0..100)  # disabled
construct_point = ConstructPoint(XCoordinate=0, YCoordinate=0, ZCoordinate=0)  # disabled
negative = Negative(Value=number_slider)  # disabled
surface = Surface(<surface referenced from the Rhino model>)

construct_point_2 = ConstructPoint(XCoordinate=0, YCoordinate=negative, ZCoordinate=0)  # disabled
line = Line(StartPoint=construct_point, EndPoint=construct_point_2)  # disabled
unit_x = UnitX(Factor=1)  # disabled
number = Number(2)  # disabled
unit_z = UnitZ(Factor=1)  # disabled
move = Move(Geometry=construct_point, Motion=unit_z)  # -> Geometry, Transform; disabled
unit_x_2 = UnitX(Factor=number)  # disabled
move_2 = Move(Geometry=move.Geometry, Motion=unit_x)  # -> Geometry, Transform; disabled
linear_array = LinearArray(Geometry=line, Direction=unit_x_2, Count=number_slider_2)  # -> Geometry, Transform; disabled
linear_array_2 = LinearArray(Geometry=move_2.Geometry, Direction=unit_x_2, Count=number_slider_2)  # -> Geometry, Transform; disabled
curve_line = CurveLine(Curve=curve, Line=linear_array.Geometry, LimitFirst=True)  # -> Points, Params, Count; disabled
box_2pt = Box2Pt(PointA=linear_array_2.Geometry, PointB=curve_line.Points, Plane=PlaneXY(0, 0, 0))  # disabled

number_slider_3 = Slider(2, range=0..10)  # disabled
number_slider_4 = Slider(9, range=0..10)  # disabled
number_slider_5 = Slider(3, range=0..10)  # disabled
number_slider_6 = Slider(1, range=0..10)  # disabled
number_slider_7 = Slider(0, range=0..10)  # disabled
number_slider_8 = Slider(2, range=0..10)  # disabled
negative_2 = Negative(Value=number_slider_8)  # disabled
vector_xyz = VectorXYZ(XComponent=number_slider_6, YComponent=negative_2, ZComponent=number_slider_7)  # -> Vector, Length; disabled
negative_3 = Negative(Value=number_slider_5)  # disabled
vector_xyz_2 = VectorXYZ(XComponent=number_slider_3, YComponent=negative_3, ZComponent=number_slider_4)  # -> Vector, Length; disabled
move_3 = Move(Geometry=construct_point, Motion=vector_xyz.Vector)  # -> Geometry, Transform; disabled
move_4 = Move(Geometry=construct_point, Motion=vector_xyz_2.Vector)  # -> Geometry, Transform; disabled
number_slider_9 = Slider(5, range=0..10)  # disabled
box_2pt_2 = Box2Pt(PointA=move_3.Geometry, PointB=move_4.Geometry, Plane=PlaneXY(0, 0, 0))  # disabled
number_slider_10 = Slider(2, range=0..10)  # disabled
unit_y = UnitY(Factor=number_slider_9)  # disabled
linear_array_3 = LinearArray(Geometry=box_2pt_2, Direction=unit_x_2, Count=number_slider_2)  # -> Geometry, Transform; disabled
negative_4 = Negative(Value=unit_y)  # disabled
linear_array_4 = LinearArray(Geometry=linear_array_3.Geometry, Direction=negative_4, Count=number_slider_10)  # -> Geometry, Transform; disabled

# ----
# Segment Surface
number_slider_11 = Slider(2, range=0..10)
unit_z_2 = UnitZ(Factor=number_slider_11)
plane_offset = PlaneOffset(BasePlane=PlaneXY(0, 0, 0), Offset=1)
linear_array_5 = LinearArray(Geometry=plane_offset, Direction=unit_z_2, Count=Slider(21, range=0..100))  # -> Geometry, Transform
brep_plane = BrepPlane(Brep=surface, Plane=linear_array_5.Geometry)  # -> flatten(Curves), Points

# ----
# Generate Elements
# (straight vectors)
number_slider_12 = Slider(26, range=0..100)
xz_plane = XZPlane(Origin=Point(0, 0, 0))
divide_curve = DivideCurve(Curve=brep_plane.Curves, Count=number_slider_12, Kinks=False)  # -> flatten(Points), Tangents, Parameters
move_to_plane = MoveToPlane(Geometry=divide_curve.Points, Plane=xz_plane, Above=True, Below=True)  # -> Geometry, Transform
move_5 = Move(Geometry=move_to_plane.Geometry, Motion=Vector(0, 0, 10))  # -> Geometry, Transform
box_2pt_3 = Box2Pt(PointA=move_5.Geometry, PointB=divide_curve.Points, Plane=PlaneXY(0, 0, 0))

# ----
# Generate Elements
# (straight vectors)
number_slider_13 = Slider(26, range=0..100)
xz_plane_2 = XZPlane(Origin=Point(0, 0, 0))
divide_curve_2 = DivideCurve(Curve=brep_plane.Curves, Count=number_slider_13, Kinks=False)  # -> flatten(Points), Tangents, Parameters
move_to_plane_2 = MoveToPlane(Geometry=divide_curve_2.Points, Plane=xz_plane_2, Above=True, Below=True)  # -> Geometry, Transform
move_6 = Move(Geometry=move_to_plane_2.Geometry, Motion="{1,0,1}")  # -> Geometry, Transform
box_2pt_4 = Box2Pt(PointA=move_6.Geometry, PointB=divide_curve_2.Points, Plane=PlaneXY(0, 0, 0))

merge = Merge(Data1=box_2pt, Data2=linear_array_4.Geometry)  # disabled
surface_closest_point = SurfaceClosestPoint(Point=divide_curve.Points, Surface=surface)  # -> Point, UVPoint, Distance
evaluate_surface = EvaluateSurface(Surface=surface, Point=surface_closest_point.Point)  # -> Point, Normal, UDirection, VDirection, Frame
param_viewer = ParamViewer(box_2pt_4)
addition = Addition(A=evaluate_surface.UDirection, B=evaluate_surface.VDirection)
vector_display = VectorDisplay(Anchor=surface_closest_point.Point, Vector=addition)
unit_x_3 = UnitX(Factor=1)
vector = Vector(addition)
area = Area(Geometry=box_2pt_4)  # -> Area, Centroid
angle = Angle(VectorA=vector, VectorB=unit_x_3)  # -> Angle, Reflex
param_viewer_2 = ParamViewer(vector)
multiplication = Multiplication(A=angle.Angle, B=Slider(0.205, range=0..2))
param_viewer_3 = ParamViewer()
rotate = Rotate(Geometry=box_2pt_4, Angle=multiplication, Plane=area.Centroid)  # -> Geometry, Transform
