# Grasshopper definition probing_program.gh (Grasshopper 1.0.7)

crv = Curve(<curve referenced from the Rhino model>)
divide = DivideCurve(Curve=crv, Count=Slider(10, range=0..100), Kinks=False)  # -> Points, Tangents, Parameters
c_script = CSharpScript(x=divide.Points)  # -> out, A; inputs x: list of Point3d
# ---------- c_script: C# ----------
List<string> gcode = new List<string>();
int retract = 50;
int probeHeight = 30;

//init
gcode.Add(";init routine");
gcode.Add("G28");
gcode.Add($"G0 X0 Y{retract} F6000");
gcode.Add($"G0 Z{probeHeight}");
gcode.Add("");

gcode.Add(";probing routine");

foreach(Point3d point in x){
    gcode.Add($"G0 Y{retract} F6000");
    gcode.Add($"G0 X{point.X}");
    gcode.Add("G38.2 Y5");
    gcode.Add("M114");
    gcode.Add("");
    }

gcode.Add(";finish routine");
gcode.Add($"G0 Y{retract}");
gcode.Add("G0 Z50");
gcode.Add("G0 X50 Y200 F6000");


A = gcode;
# ---------- end c_script ----------
panel = Panel(c_script.A)
