# Grasshopper definition 01_pattern_circle_01.gh (Grasshopper 1.0.7)

number_slider = Slider(3, range=0..20)
Z = UnitZ(Factor=1)
pt = Point(Point(0, 0, 0))
number_slider_2 = Slider(1, range=0..1)
number_slider_3 = Slider(8, range=1..10)
multiplication = Multiplication(A=number_slider, B=2)
circle = CircleCNR(Center=pt, Normal=Z, Radius=number_slider)
sqgrid = Square(Plane=pt, Size=multiplication, ExtentX=number_slider_2, ExtentY=number_slider_2)  # -> flatten(Cells), Points
arrrec = RectangularArray(Geometry=circle, Cell=sqgrid.Cells, XCount=number_slider_3, YCount=number_slider_3)  # -> graft(Geometry), Transform
divide = DivideCurve(Curve=arrrec.Geometry, Count=Slider(4, range=0..30), Kinks=False)  # -> flatten(Points), Tangents, Parameters
subcrv = SubCurve()
shatter = Shatter(Curve=arrrec.Geometry, Parameters=divide.Parameters)
panel = Panel(shatter)
join = JoinCurves(Preserve=False)
viewer = ParamViewer(shatter)
