# Grasshopper definition twistedTower.gh (Grasshopper 1.0.7)

range = Range(Domain=Domain(0, 1), Steps=expr("x-1", 10))
number_slider = Slider(18, range=0..100)
polygon = Polygon(
    Plane=PlaneXY(0, 0, 0),
    Radius=Slider(4, range=0..10),
    Segments=Slider(4, range=0..10),
    FilletRadius=Slider(1.99, range=0..10))  # -> Polygon, Length
graph = GraphMapper(
    range,
    x0=0,
    x1=1,
    y0=0,
    y1=1,
    container_name="Sine",
    Equation_px=[0.6993585229, 0.03623188287],
    Equation_py=[0.213937521, 0.9492753744])
series = Series(Start=0, Step=Slider(3, range=0..10), Count=number_slider)
bnd = Bounds(Numbers=graph)
Z = UnitZ(Factor=series)
dom = ConstructDomain(DomainStart=Slider(1.395, range=0..10), DomainEnd=Slider(2.269, range=0..10))
move = Move(Geometry=polygon.Polygon, Motion=Z)  # -> Geometry, Transform
remap = RemapNumbers(Value=graph, Source=bnd, Target=dom)  # -> Mapped, Clipped
cp = ControlPoints(Curve=move.Geometry)  # -> Points, Weights, Knots
avr = Average(Input=cp.Points)  # -> flatten(ArithmeticMean)
series_2 = Series(Start=0, Step=Slider(0.227, range=0..10), Count=number_slider)
scale_nu = ScaleNU(Geometry=move.Geometry, Plane=avr, ScaleX=remap.Mapped, ScaleY=remap.Mapped, ScaleZ=1)  # -> Geometry, Transform
rotate = Rotate(Geometry=scale_nu.Geometry, Angle=series_2, Plane=avr)  # -> Geometry, Transform
geo = Geometry(<brep referenced from the Rhino model>)
loft = Loft(Curves=rotate.Geometry, Options={Adjust=False, Closed=False, LoftEnds=0, LoftSimp=0, LoftType=0, Rebuild=10, Refit=0.01})
neg = Negative(Value=Slider(0.6, range=0..1))
cap = CapHoles(Brep=loft)
bbox = BoundingBox(Content=geo, Plane=PlaneXY(0, 0, 0))  # -> Box, Box_2
offset = OffsetSurface(Surface=loft, Distance=neg, Retrim=True)
divide = DivideDomain²(Domain=offset, UCount=Slider(16.947, range=0..100), VCount=Slider(15, range=0..100))
bbox_2 = BoundingBox(Plane=PlaneXY(0, 0, 0))  # -> Box, Box_2
sbox = SurfaceBox(Surface=offset, Domain=divide, Height=Slider(0.5, range=0..1))
morph = BoxMorph(Geometry=geo, Reference=bbox.Box, Target=sbox)
