# Grasshopper definition object_along_curve.gh (Grasshopper 1.0.7)

# Divide curve and populate
# with perpendicular planes
crv = Curve(<curve referenced from the Rhino model>)
# Find origin of input geometry
# and put plane on it
geo = Geometry(<brep referenced from the Rhino model>)
volume = Volume(Geometry=geo)  # -> Volume, Centroid
divide = DivideCurve(Curve=crv, Count=Slider(24, range=0..40), Kinks=False)  # -> Points, Tangents, Parameters
xy = XYPlane(Origin=volume.Centroid)
pframe = PerpFrame(Curve=crv, Parameter=divide.Parameters)
orient = Orient(Geometry=geo, Source=xy, Target=pframe)  # -> Geometry, Transform
Y = UnitY(Factor=Slider(12, range=0..30))
move = Move(Geometry=orient.Geometry, Motion=Y)  # -> Geometry, Transform
