# Grasshopper definition graph_tool.gh (Grasshopper 1.0.7)

crv = Curve(<curve referenced from the Rhino model>)
range = Range(Domain=Slider(50, range=0..100), Steps=Slider(20, range=0..100))
divide = DivideCurve(Curve=crv, Count=Slider(50, range=0..100), Kinks=False)  # -> Points, Tangents, Parameters
range_2 = Range(Domain=Domain(0, 1), Steps=Slider(20, range=0..100))
panel = Panel(range)
python = GhPythonScript()  # -> Out, A
python_2 = GhPythonScript(x=divide.Points)  # -> a; inputs x: Vector3d
# ---------- python_2: Python ----------
import rhinoscriptsyntax as rs
import ghpythonlib.components


"a = ghpythonlib.components.Circle(ghpythonlib.components.ConstructPoint(0,0,0),x)"

a = 'G0 X{0} Y{1} Z{2} '.format(x[0],x[1],40);
# ---------- end python_2 ----------
graph = GraphMapper(
    range_2,
    x0=0,
    x1=1,
    y0=0,
    y1=1,
    amplitude=0.3,
    container_name="Perlin",
    decay=0.3,
    frequency=0.06115108728,
    x_offset=0.7913669348,
    y_offset=0.4057971239)
multiplication = Multiplication(A=Slider(37, range=0..1000), B=graph)
panel_2 = Panel(python_2)
pt = ConstructPoint(XCoordinate=range, YCoordinate=multiplication, ZCoordinate=0)
