# Grasshopper definition graph_tool_2.gh (Grasshopper 1.0.7)

pipeline = GeometryPipeline(
    GroupByLayer=False,
    GroupByType=False,
    IncludeHidden=True,
    IncludeLocked=True,
    LayerFilter="Default",
    NameFilter="*",
    SublayerFiltering=True,
    TypeFilter=4)
number_slider = Slider(72, range=0..100)

# ----
# Copy Data
number_slider_2 = Slider(4, range=0..10)
Z = UnitZ(Factor=number_slider_2)
arrlinear = LinearArray(Geometry=pipeline, Direction=Z, Count=number_slider)  # -> Geometry, Transform
topoly = CurveToPolyline(Curve=arrlinear.Geometry, ToleranceDistance=0, ToleranceAngle=0)  # -> Polyline, Segments
pcen = PolygonCenter(Polyline=topoly.Polyline)  # -> CenterV, CenterE, CenterA

# ----
# Graph Mapper
number_slider_3 = Slider(1, range=0..100)
dom = ConstructDomain(DomainStart=number_slider_3, DomainEnd=Slider(2, range=0..1000))
range = Range(Domain=dom, Steps=expr("x-1", number_slider))
graph = GraphMapper(range, x0=1, x1=2, y0=1, y1=2, container_name="Sine", Equation_px=[0.8243815303, 1], Equation_py=[0.4718578458, 1])

# ----
# Graph Mapper
number_slider_4 = Slider(1, range=0..100)
dom_2 = ConstructDomain(DomainStart=number_slider_4, DomainEnd=Slider(2, range=0..1000))
range_2 = Range(Domain=dom_2, Steps=expr("x-1", number_slider))
graph_2 = GraphMapper(
    range_2,
    x0=1,
    x1=2,
    y0=1,
    y1=2,
    Ox=0.3849102557,
    Oy=0.2655584216,
    Px=0.6832903624,
    Py=0.401960969,
    container_name="Parabola")

addition = Addition(A=graph, B=graph_2)
scale = Scale(Geometry=arrlinear.Geometry, Center=pcen.CenterV, Factor=addition)  # -> Geometry, Transform
panel = Panel(graph_2)
loft = Loft(Curves=scale.Geometry, Options={Adjust=False, Closed=False, LoftEnds=0, LoftSimp=0, LoftType=0, Rebuild=10, Refit=0.01})
