# Grasshopper definition websocket.gh (Grasshopper 1.0.7)

websocket_client_start = WebsocketClientStart(Address="ws://192.168.86.77:8080", InitalMessage="Hello World", Reset=Button())
websocket_client_receiver = WebsocketClientReceiver(WebsocketObjects=websocket_client_start, AutoUpdate=True)  # -> Message, Status
panel = Panel(websocket_client_receiver.Message)
pt = ConstructPoint(XCoordinate=0, YCoordinate=0, ZCoordinate=websocket_client_receiver.Message)
