# Grasshopper definition kangeroo_tutorial.gh (Grasshopper 1.0.7)
# plug-ins: Kangaroo2 Components

number_slider = Slider(15, range=0..100)
srf = Surface(<surface referenced from the Rhino model>)
Y = UnitY(Factor=Slider(0, range=0..1000))
move = Move(Geometry=srf, Motion=Y)  # -> Geometry, Transform
debrep = DeconstructBrep(Brep=move.Geometry)  # -> Faces, Edges, Vertices
pt = Point(debrep.Vertices)
mesh_uv = MeshSurface(Surface=move.Geometry, UCount=number_slider, VCount=number_slider, Overhang=True, Equalize=False)
edgelengths = EdgeLengths(Mesh=move.Geometry, LengthFactor=Slider(0.59, range=0..1), Strength=Slider(39, range=0..1000))
anchor = Anchor(Point=pt, Strength=10000)
vertexloads = VertexLoads(Mesh=mesh_uv, Strength=Slider(5, range=-30..30))
bouncysolver = BouncySolver(
    GoalObjects=[edgelengths, vertexloads, anchor],
    Reset=Button(),
    Threshold=1e-15,
    Tolerance=0.01,
    Damping=0.99,
    Iterations=10,
    On=True)  # -> I, V, O
