# Grasshopper definition panelling.gh (Grasshopper 1.0.7)
# plug-ins: PTComponentLibrary, LunchBox

srf = Surface(<surface referenced from the Rhino model>)
Y = UnitY(Factor=Slider(13, range=0..100))
move = Move(Geometry=srf, Motion=Y)  # -> Geometry, Transform
brep = Brep(<brep referenced from the Rhino model>)
brep_2 = Brep([<brep referenced from the Rhino model> x4])
ptsrfdomnum = SurfaceDomainNumber(Surface=move.Geometry, UNumber=Slider(5, range=0..100), VNumber=Slider(5, range=0..100))
ptrandatts = RandomAttraction(Grid=ptsrfdomnum, Magnitude=1)  # -> Grid, Weights
ptcoordinate = Coordinates(Grid=ptsrfdomnum, Surface=move.Geometry, AddEnds=True, FlipZ=Toggle(False))  # -> Origin, X_vector, Y_vector, Z_vector
ptfaces = GenerateFaces(Grid=ptsrfdomnum, PanelShape=Slider(3, range=0..100), Surface=move.Geometry)
amp = Amplitude(Vector=ptcoordinate.Z_vector, Amplitude=Slider(0.5, range=0..1))
unroll = UnrollBrep(JoinUnrolled=False)
move_2 = Move(Geometry=ptcoordinate.Origin, Motion=amp)  # -> Geometry, Transform
ptmorph3d = Morph3D(Grid1=ptsrfdomnum, Grid2=move_2.Geometry, PatternObjects=brep, Shift_i=1, Shift_j=1, Pull=False)
