# Grasshopper definition 01_pattern_circle_01.gh (Grasshopper 1.0.7)

number_slider = Slider(1, range=0..20)
Z = UnitZ(Factor=1)
pt = Point(Point(0, 0, 0))
number_slider_2 = Slider(1, range=0..1)
multiplication = Multiplication(A=number_slider, B=2)
circle = CircleCNR(Center=pt, Normal=Z, Radius=number_slider)
sqgrid = Square(Plane=pt, Size=multiplication, ExtentX=number_slider_2, ExtentY=number_slider_2)  # -> flatten(Cells), Points
dom = ConstructDomain(DomainStart=Slider(-1, range=-1..1), DomainEnd=Slider(4, range=0..100))
arrrec = RectangularArray(Geometry=circle, Cell=sqgrid.Cells, XCount=Slider(8, range=1..10), YCount=Slider(6, range=1..10))  # -> graft(Geometry), Transform
random = Random(Range=dom, Number=Slider(23, range=0..40), Seed=2)
divide = DivideCurve(Curve=arrrec.Geometry, Count=Slider(4, range=0..30), Kinks=False)  # -> flatten(Points), Tangents, Parameters
bool = Boolean(random)
python = GhPythonScript(x=random)  # -> out, a
# ---------- python: Python ----------
import rhinoscriptsyntax as rs

if x > 0: 
    a = 'true'
else:
    a = 'false'
# ---------- end python ----------
shatter = Shatter(Curve=arrrec.Geometry, Parameters=divide.Parameters)  # -> flatten(Segments)
panel = Panel(shatter)
panel_2 = Panel(python.a)
cull = CullPattern(List=shatter, CullPattern=python.a)
item = ListItem(List=shatter, Index=0, Wrap=True)
