# Grasshopper definition 2_trouchet_tiles.gh (Grasshopper 1.0.7)

sqgrid = Square(Plane=PlaneXY(0, 0, 0), Size=Slider(1, range=0..10), ExtentX=Slider(20, range=0..100), ExtentY=Slider(9, range=0..100))  # -> graft(Cells), Points
pcen = PolygonCenter(Polyline=sqgrid.Cells)  # -> CenterV, CenterE, CenterA
explode = Explode(Curve=sqgrid.Cells, Recursive=True)  # -> Segments, Vertices
number_slider = Slider(0.3, range=0..1)
eval = EvaluateLength(Curve=explode.Segments, Length=Slider(0.5, range=0..1), Normalized=True)  # -> Point, Tangent, Parameter
tstat = TreeStatistics(Tree=sqgrid.Cells)  # -> Paths, Length, Count
item = ListItem(List=eval.Point, Index=0, Wrap=True)  # -> Item, Item1, Item2, Item3
pt = Point(pcen.CenterV)
Y = UnitY(Factor=number_slider)
X = UnitX(Factor=number_slider)
bzspan = BezierSpan(StartPoint=item.Item, StartTangent=Y, EndPoint=item.Item3, EndTangent=X)  # -> Curve, Length, Domain
random = Random(Range="0 to 3", Number=tstat.Count, Seed=Slider(1884, range=0..10000), Integers=True)  # -> graft(Random)
multiplication = Multiplication(A=random, B="90")
rot3d = Rotate3D(Geometry=bzspan.Curve, Angle=degrees("180"), Center=pt, Axis=Vector(0, 0, 1))  # -> Geometry, Transform
merge = Merge(Data1=bzspan.Curve, Data2=rot3d.Geometry)
rot3d_2 = Rotate3D(Geometry=merge, Angle=degrees(multiplication), Center=pt, Axis=Vector(0, 0, 1))  # -> flatten(Geometry), Transform
join = JoinCurves(Curves=rot3d_2.Geometry, Preserve=False)
panel = Panel(rot3d_2.Geometry)
topoly = CurveToPolyline(Curve=join, ToleranceDistance=0, ToleranceAngle=degrees(Slider(15, range=0..100)))  # -> Polyline, Segments
