# Grasshopper definition 2D_linegrowth.gh (Grasshopper 1.0.7)
# plug-ins: Kangaroo2 Components

mesh = Mesh(<mesh referenced from the Rhino model>)
crv = Curve(<curve referenced from the Rhino model>)
planesrf = PlaneSurface(Plane=PlaneXY(0, 0, 0), XSize=Slider(83, range=0..100), YSize=Slider(100, range=0..100))
divide = DivideCurve(Curve=crv, Count=Slider(2000, range=0..10000), Kinks=False)  # -> flatten(Points), Tangents, Parameters
pline = PolyLine(Vertices=divide.Points, Closed=False)
disc = Discontinuity(Curve=pline, Level=2)  # -> Points, Parameters
explode = Explode(Curve=pline, Recursive=True)  # -> Segments, Vertices
# Set this to 1 before starting sim and increase slowly!
number_slider = Slider(29, range=1..40)
len = Length(Curve=explode.Segments)
avr = Average(Input=len)
multiplication = Multiplication(A=avr, B=number_slider)
length_line = LengthLine(Line=explode.Segments, Length=multiplication, Strength=10)
onmesh = OnMesh(Points=disc.Points, Mesh=mesh, Strength=1)
sc = SphereCollide(Points=disc.Points, Radius=multiplication, Strength=1)
merge = Merge(Data1=length_line, Data2=sc, Data3=onmesh)
solver = Solver(GoalObjects=merge, Reset=Button(), Threshold=1e-15, Tolerance=0.01, On=Toggle(False))  # -> I, V, O
pline_2 = PolyLine(Vertices=solver.V, Closed=False)
intcrv_t = InterpolateT(Vertices=solver.V, TangentStart=Vector(0, 0, 0), TangentEnd=Vector(0, 0, 0), KnotStyle=1)  # -> Curve, Length, Domain
topoly = CurveToPolyline(Curve=intcrv_t.Curve, ToleranceDistance=0, ToleranceAngle=degrees(Slider(4, range=0..100)))  # -> Polyline, Segments
