# Grasshopper definition spiral.gh (Grasshopper 1.0.7)
# plug-ins: Pufferfish, ClipperComponents

number_slider = Slider(0.1, range=0..0.1)
txt = Text()
c_script = CSharpScript(rad=Slider(7, range=0..10), paper=Slider(0.2, range=0..1))  # -> out, A, B, C; inputs rad: Int32, paper: Double
# ---------- c_script: C# ----------
List<Point3d> plist = new List<Point3d>();
List<int> heights = new List<int>();
List <Circle> circles = new List<Circle>();
List<Rectangle> recs = new List<Rectangle>(); 



double angle = 2* Math.PI / 40;


double _x = 0;
double _y = 0;
double paper_index = 0;
double radi = 5;

for(int i = 0; i < 30; i++){
    _x = Math.Cos(angle*i)*rad;
    _y = Math.Sin(angle*i)*rad;
    plist.Add(new Point3d(_x, _y,paper_index));
    heights.Add(i);
    circles.Add(new Circle(new Point3d(_x, _y,paper_index), radi));
    recs.Add(new Rectangle(

    paper_index = paper_index+paper;
    radi += 0.5; ;
}

A = plist;
B = heights;
C = circles;
# ---------- end c_script ----------
points = PointList(Points=c_script.A)
panel = Panel(c_script.B)
pt = ConstructPoint(XCoordinate=0, YCoordinate=0, ZCoordinate=0)
pt_2 = ConstructPoint(XCoordinate=0, YCoordinate=0, ZCoordinate=c_script.B)
pt_3 = ConstructPoint(XCoordinate=0, YCoordinate=0, ZCoordinate=0)
circle = CircleCNR(Center=pt, Normal=Vector(0, 0, 1), Radius=Slider(26, range=0..100))
crv = Curve(<curve referenced from the Rhino model>)
number_slider_2 = Slider(7, range=0..10)
move2pt = MoveToPoint(Geometry=circle, PointA=pt, PointB=c_script.A)  # -> Moved, Vector, Transform
move2pt_2 = MoveToPoint(Geometry=crv, PointA=pt_3, PointB=pt_2)  # -> Moved, Vector, Transform
number_slider_3 = Slider(0.3, range=0..1)
item = ListItem(List=move2pt_2.Moved, Index=number_slider_2, Wrap=True)
Z = UnitZ(Factor=c_script.B)
item_2 = ListItem(List=move2pt.Moved, Index=number_slider_2, Wrap=True)
panel_2 = Panel(item_2)
polyboolean = PolylineBoolean(
    A=graft(move2pt.Moved),
    B=graft(move2pt_2.Moved),
    BooleanType=Slider(3, range=0..10),
    Plane=Plane(origin=(0, 0, 0), x=(0, 0, 0), y=(0, 0, 0)),
    Tolerance=0.001,
    EvenOdd=True)
move = Move(Geometry=polyboolean, Motion=Z)  # -> Geometry, Transform
boundary = BoundarySurfaces(Edges=polyboolean)
number_slider_4 = Slider(0, range=0..1)
Z_2 = UnitZ(Factor=Slider(0.1, range=0..1))
extr = Extrude(Base=boundary, Direction=Z_2)
