# Grasshopper definition post_prototype_board.gh (Grasshopper 1.0.7)

# name a layer in Rhino «work» and
# put curves you want to execute on
# that layer
pipeline = GeometryPipeline(
    GroupByLayer=False,
    GroupByType=False,
    IncludeHidden=True,
    IncludeLocked=True,
    LayerFilter="work",
    NameFilter="*",
    SublayerFiltering=True,
    TypeFilter=4)
topoly = CurveToPolyline(Curve=pipeline, ToleranceDistance=0, ToleranceAngle=degrees(Slider(5, range=0..100)))  # -> Polyline, Segments
number_slider = Slider(49, range=0..100)

# ----
# Visualizer (prototype)
pt = Point(Point(0, 0, 0))
viusalize_toolpaths = CSharpScript(x=topoly.Polyline, y=pt, rh=number_slider)  # -> out, A; inputs x: list of Polyline, y: Point3d, rh: Int32
# ---------- viusalize_toolpaths: C# usings ----------
using System.Linq;
# ---------- viusalize_toolpaths: C# ----------
DataTree<Polyline> moves = new DataTree<Polyline>();
List<Polyline> polys = new List<Polyline>();

Point3d lastPos = y;

polys = x;

polys = polys.OrderBy(c => c.ClosestPoint(y)).ToList();

    Polyline first_move = new Polyline();
    first_move.Add(y);
    first_move.Add(y.X, y.Y, rh);

    lastPos = new Point3d(y.X, y.Y,rh);

    moves.Add(first_move);


    foreach(Polyline c in polys){
        //pre move
        Polyline preWorkMove = new Polyline();
        preWorkMove.Add(lastPos);
        preWorkMove.Add(c[0].X, c[0].Y, rh);
        preWorkMove.Add(c[0].X, c[0].Y, c[0].Z);
        moves.Add(preWorkMove);
        lastPos = new Point3d(c[0].X, c[0].Y, 0);

        //move
        Polyline work_move = new Polyline();
        foreach(Point3d p in c){
            work_move.Add(p);
        }
        moves.Add(work_move);


        lastPos = work_move.Last;

        //post move
        Polyline postWorkMove = new Polyline();
        postWorkMove.Add(lastPos);
        postWorkMove.Add(lastPos.X, lastPos.Y, rh);
        moves.Add(postWorkMove);
        lastPos = new Point3d(lastPos.X, lastPos.Y, rh);

    }

A = moves;
# ---------- end viusalize_toolpaths ----------

# ----
# code lives here
vespidae_post = CSharpScript(
    work_feedrate=Slider(4000, range=0..10000),
    move_feedrate=Slider(4000, range=0..10000),
    retract_height=number_slider,
    input_polyline=topoly.Polyline)  # -> gcode; inputs input_polyline: list
# ---------- vespidae_post: C# ----------
List<string> outputGcode = new List<string>();

//add stuff you want to do before executing polyline

outputGcode.Add("; pre work moves");
//home machine
outputGcode.Add("G28");
outputGcode.Add("");    

//loop for each polyline
foreach(Curve cur in input_polyline){
    if(cur.IsPolyline()){
        //extract polyline 
        Polyline poly;
        cur.TryGetPolyline(out poly);
        
        outputGcode.Add(";NEW POLYLINE"); 
        
        //retract tool
        outputGcode.Add(";retract tool"); 
        outputGcode.Add($"G0 Z{retract_height} F{move_feedrate}"); 
        
        //go to first point of polyline e.g first point of in operation
        outputGcode.Add("; move to work position"); 
        outputGcode.Add($"G0 X{poly[0].X} Y{poly[0].Y}");

        
        outputGcode.Add("; execute work"); 
        //set feedrate of operation 
        outputGcode.Add($"G0 F{work_feedrate}");
         
        //loop through each point in polyline and make gcode
        foreach (Point3d p in poly){
            outputGcode.Add($"G0 X{p.X} Y{p.Y} Z{p.Z}"); 
        }
    }
}

    
gcode = outputGcode;
# ---------- end vespidae_post ----------
# use this panel to stream
# gcode to duet web insterface
panel = Panel(vespidae_post)
